# Requirement set 0 best_requirements (R2017b)

## 1 [#7] MEP Measurement

## 2 [#8] Motor Hotspot Search

## 3 [#9] Motor Threshold Hunting

## 4 [#10] MEP IOC

## 5 [#11] EEGTMS

## 6 [#12] rTMS Intervention

## 7 [#13] Multimodal Experiment

## 8 [#14] TEP Hotspot Search

## 9 [#15] TEP Measurement

## 10 [#16] TEP IOC

## 11 [#20] Multimodal Experiment

### 11.1 [#22] Interactive application

#### 11.1.1 [#23] Iconing of library
List of icons:
stimulator (any device icon would work here)
condition (any panel with tabs would here )
sp (sq wave)
pp (cs+ts)
pp (ts+scs)
train (three sq waves)
Icons for later on:
Audio Masking
Audio Stimulus + Video stimulus would go as part in the hardware configuration panel
Priority: Essential

#### 11.1.2 [#44] create the pulse shapes interactively as per the given inputs

##### 11.1.2.1 [#45] on the target channel axes line the left tick mark is visible therefore switch the tickmarks

#### 11.1.3 [#29] interacting with axes to add pulses on any stimulator
add ui menu to each of the pulses
uimenu will check how many stimulators are available in that condition
uimenu will show those stimulator 1 ..... stimulator N on the menu to select for
user will select any one
the pulse would go there
OR
click on the pulse buttons
a easy to use selectionox to be open up infront of screen to choose on which axes it has to be placed
as soon as the user clicks on the stim no, close that dialogue box and place the pulse immediately
just take the stim no flag using this approach
OR
select the pulse
left click on that very stimulator's line plot where you want to place it, and it would just place it there
(just that the lines needs to be slightly thick)
Finally this idea is great
click on the plot
use the button down function to chane its colour to red (which means it is selected now)
also assign the slcted no of stimulator to the rspctv var
then click on the pulse icon
and the pulse would be added to that very stimulator
also change its colour back to the black as soon as the pulse is added!
Later on:
drag and drop interaction can be placed but thats so much time consuiming therefore not in the list even yet
Priority: Essential

#### 11.1.4 [#30] deleting a particularly added pulse
Priority: Essential

#### 11.1.5 [#31] deleting a particular added stimulator
Priority: Essential

#### 11.1.6 [#32] changing the Target chanel using the Global Channel Selector
The global channel selector pannel would save the data in a cell str format to the targetChannel string

#### 11.1.7 [#33] callback based saving of the inputs data
Display periods are still not linked properly
Priority: Essential

#### 11.1.8 [#34] callback based reloading of the axes when measures are changed from listbox
Priority: Essential

##### 11.1.8.1 [#49] default par multimodal
obj.bst.inputs.ylimMax=2000;
obj.bst.inputs.ylimMin=-2000;
obj.bst.inputs.mep_onset=(obj.pi.mm.mepOnset.String)/1000;
obj.bst.inputs.mep_offset=(obj.pi.mm.mepOffset.String)/1000;
obj.bst.inputs.stim_mode='MSO'
obj.bst.inputs.stop_event=0
thse kind of parameters have to be dealt with yet
Priority: High

#### 11.1.9 [#41] warning and error handling at the frontend interface
eg if someone tries to add different kind of pulses on one stimulators
Priority: Medium

##### 11.1.9.1 [#50] if no stimulator is selected but pulse is selected, throw an error dialogue box
Priority: Medium

##### 11.1.9.2 [#51] if different kind of pulses are being placed on a stimulator, throw an error dialogue box
before adding the pulse,
in the start of the pulse callback
check if the previous pulses exists on the same stimulator
if yes, check if this stim_mode is same as of that pulse
otherwise throw an error

### 11.2 [#24] MEP Measurement

### 11.3 [#25] IOC Measurement

### 11.4 [#26] Motor Thresholding

### 11.5 [#27] Psychometric Thresholding

### 11.6 [#28] EEGTMS

## 12 [#35] BEST GUI

### 12.1 [#37] Cleaning
No command should be visible at the command line except for those coming from external toolboxes e.g. fieldtrip magic or anything ekse

#### 12.1.1 [#46] Nothing to be printed on command line

#### 12.1.2 [#48] variables naming convention check
read this: https://www.ee.columbia.edu/~marios/matlab/MatlabStyle1p5.pdf

## 13 [#38] Hardware Configuration

### 13.1 [#39] Auditory stimulus device addition among output devices

### 13.2 [#40] Visual stimulus device addition among output devices