% Requirement links of BEST.m (R2017b)

% line 1434 links to 0 best_requirements.slreqx#29: interacting with axes to add pulses on any stimulator
            obj.pi.mm.stim.(cd).(st).plt=plot([-45 45],[-1*obj.pi.mm.stim.(cd).no -1*obj.pi.mm.stim.(cd).no],'Color','k','parent',obj.pi.mm.cond.(cd).ax,'LineWidth',2,'Tag',num2str(obj.pi.mm.stim.(cd).no),'ButtonDownFcn',@cb_stimulatorSelector); %line

% lines 1445-1472 links to 0 best_requirements.slreqx#33: callback based saving of the inputs data
            text(0,-1*obj.pi.mm.stim.(cd).no,'click to tag device','VerticalAlignment','bottom','Color',[0.50 0.50 0.50],'FontSize',9,'FontAngle','italic','Tag',num2str(obj.pi.mm.stim.(cd).no),'ButtonDownFcn',@obj.cb_pi_mm_output_device)
            
            function cb_stimulatorSelector(source,~)
                if(isvalid(obj.pi.mm.stimulatorSelector))
                    obj.pi.mm.stimulatorSelector.Color='k';
                end
                obj.pi.mm.stim.(cd).slctd=str2double(source.Tag);
                source.Color='b';
                obj.pi.mm.stimulatorSelector=source;
            end
        end
        function cb_pi_mm_pulse(obj,source,~)
            % 11-Mar-2020 18:13:21
            cd=['cd' num2str(obj.pi.mm.tab.SelectedChild)];
            
%             obj.pi.mm.stim.(cd).slctd=1 ;
            
            
            st=['st' num2str(obj.pi.mm.stim.(cd).slctd)];
            obj.pi.mm.stim.(cd).(st).pulse_count=obj.pi.mm.stim.(cd).(st).pulse_count+1;
            
            switch source.Tag
                case 'single_pulse'
                    obj.pi.mm.stim.(cd).(st).pulse_types{1,obj.pi.mm.stim.(cd).(st).pulse_count}=cellstr('single_pulse');
                    text(obj.pi.mm.stim.(cd).(st).pulse_count-0.25,-obj.pi.mm.stim.(cd).slctd+0.41,'       TS:[?] %MSO','VerticalAlignment','bottom','Color',[0.50 0.50 0.50],'FontSize',7,'FontAngle','italic','UserData',[obj.pi.mm.stim.(cd).(st).pulse_count,obj.pi.mm.stim.(cd).slctd],'ButtonDownFcn',@obj.cb_pi_mm_sp_inputfig) % 11-Mar-2020 14:49:00
                   
%                     p1 = [1.15 -1.1];                         % First Point
                    %                     p2 = [2 -1.1];                         % Second Point

% lines 1447-1454 links to 0 best_requirements.slreqx#29: interacting with axes to add pulses on any stimulator
            function cb_stimulatorSelector(source,~)
                if(isvalid(obj.pi.mm.stimulatorSelector))
                    obj.pi.mm.stimulatorSelector.Color='k';
                end
                obj.pi.mm.stim.(cd).slctd=str2double(source.Tag);
                source.Color='b';
                obj.pi.mm.stimulatorSelector=source;
            end

% lines 1479-1662 links to 0 best_requirements.slreqx#34: callback based reloading of the axes when measures are changed from listbox
%                     obj.pi.mm.stim.(st).pulse_specs=text(obj.pi.mm.stim.(cd).(st).pulse_count-0.25,-obj.pi.mm.stim.(cd).slctd+0.4,{'TS:[?], CS:[?] %MSO', 'ISI:[?] ms'},'VerticalAlignment','bottom','Color',[0.50 0.50 0.50],'FontSize',7,'FontAngle','italic','UserData',[obj.pi.mm.stim.(cd).(st).pulse_count,obj.pi.mm.stim.(cd).slctd])
                    text(obj.pi.mm.stim.(cd).(st).pulse_count-0.25,-obj.pi.mm.stim.(cd).slctd+0.4,{'TS:[?], CS:[?] %MSO', 'ISI:[?] ms'},'VerticalAlignment','bottom','Color',[0.50 0.50 0.50],'FontSize',7,'FontAngle','italic','UserData',[obj.pi.mm.stim.(cd).(st).pulse_count,obj.pi.mm.stim.(cd).slctd],'ButtonDownFcn',@obj.cb_pi_mm_pp_inputfig) % 11-Mar-2020 14:49:00
               
                case 'train'
                    obj.pi.mm.stim.(cd).(st).pulse_types{1,obj.pi.mm.stim.(cd).(st).pulse_count}=cellstr('train');
                    obj.pi.mm.stim.(st).pulse_specs=text(obj.pi.mm.stim.(cd).(st).pulse_count,-obj.pi.mm.stim.(cd).slctd+0.4,{'Pulses:[?], f:[?] Hz', 'TS:[?] %MSO'},'VerticalAlignment','bottom','Color',[0.50 0.50 0.50],'FontSize',7,'FontAngle','italic','UserData',[obj.pi.mm.stim.(cd).(st).pulse_count,obj.pi.mm.stim.(cd).slctd],'ButtonDownFcn',@obj.cb_pi_mm_train_inputfig); % 11-Mar-2020 14:49:00
                    
            end
            
            
            % delete the previous plot
            delete(obj.pi.mm.stim.(cd).(st).plt)
            % make the x and y vector for new one
            x=[];
            y=[];
            for i=1:obj.pi.mm.stim.(cd).(st).pulse_count
                switch char(obj.pi.mm.stim.(cd).(st).pulse_types{1,i})
                    case 'single_pulse'
                        disp sp
                        x{i}=([i i i+0.15 i+0.15]);
                        y{i}=[-obj.pi.mm.stim.(cd).slctd -obj.pi.mm.stim.(cd).slctd+0.4 -obj.pi.mm.stim.(cd).slctd+0.4 -obj.pi.mm.stim.(cd).slctd];
                    case 'paired_pulse'
                        disp pp
                        x{i}=[i i i+0.15 i+0.15 i+0.25 i+0.25 i+0.40 i+0.40];
                        y{i}=[-obj.pi.mm.stim.(cd).slctd -obj.pi.mm.stim.(cd).slctd+0.20 -obj.pi.mm.stim.(cd).slctd+0.20 -obj.pi.mm.stim.(cd).slctd -obj.pi.mm.stim.(cd).slctd -obj.pi.mm.stim.(cd).slctd+0.4 -obj.pi.mm.stim.(cd).slctd+0.4 -obj.pi.mm.stim.(cd).slctd];
                    case 'train'
                        disp train
                        %                         x(i)=[i i i+0.20 i+0.20 i+0.30 i+0.30 i+0.50 i+0.50 i+0.60 i+0.60 i+0.80 i+0.80];
                        x{i}=[i i i+0.15 i+0.15 i+0.25 i+0.25 i+0.40 i+0.40 i+0.50 i+0.50 i+0.65 i+0.65];
                        %                         y{i}={[-obj.pi.mm.stim.(cd).slctd -obj.pi.mm.stim.(cd).slctd+0.5 -obj.pi.mm.stim.(cd).slctd+0.5 -obj.pi.mm.stim.(cd).slctd -obj.pi.mm.stim.(cd).slctd -obj.pi.mm.stim.(cd).slctd+0.5 -obj.pi.mm.stim.(cd).slctd+0.5 -obj.pi.mm.stim.(cd).slctd]};
                        
                        y{i}=-obj.pi.mm.stim.(cd).slctd+[0 0.4 0.4 0 0 0.4 0.4 0 0 0.4 0.4 0];
                end
            end
            
            x=[-45 cell2mat(x) 45];
            y=[-obj.pi.mm.stim.(cd).slctd cell2mat(y) -obj.pi.mm.stim.(cd).slctd];
            
            obj.pi.mm.stim.(cd).(st).plt=plot(x,y,'Color','k','parent',obj.pi.mm.cond.(cd).ax,'LineWidth',2,'Tag',num2str(obj.pi.mm.stim.(cd).slctd),'ButtonDownFcn',@cb_stimulatorSelector); %line
            
            drawArrow = @(x,y) quiver( x(1),y(1),x(2)-x(1),y(2)-y(1),0,'color','k' )
            obj.pi.mm.stim.(st).pulse_time=text(obj.pi.mm.stim.(cd).(st).pulse_count-1+0.5,-obj.pi.mm.stim.(cd).slctd-0.05,'t:? ms','VerticalAlignment','top','Color',[0.50 0.50 0.50],'FontSize',9,'FontAngle','italic','UserData',[obj.pi.mm.stim.(cd).(st).pulse_count,obj.pi.mm.stim.(cd).slctd],'ButtonDownFcn',@obj.cb_pi_mm_timing)
            
            obj.pi.mm.stim.(st).pulse_arrow1=drawArrow([obj.pi.mm.stim.(cd).(st).pulse_count-1 obj.pi.mm.stim.(cd).(st).pulse_count-1+1],[-obj.pi.mm.stim.(cd).slctd-0.05 -obj.pi.mm.stim.(cd).slctd-0.05])
            obj.pi.mm.stim.(st).pulse_arrow2=drawArrow([obj.pi.mm.stim.(cd).(st).pulse_count-1+1 obj.pi.mm.stim.(cd).(st).pulse_count-1],[-obj.pi.mm.stim.(cd).slctd-0.05 -obj.pi.mm.stim.(cd).slctd-0.05])
            
            
            if(obj.pi.mm.cond.(cd).ax.XLim(2)<obj.pi.mm.stim.(cd).(st).pulse_count+1)
                obj.pi.mm.cond.(cd).ax.XLim(2)=obj.pi.mm.stim.(cd).(st).pulse_count+1;
            end
            
            
            function cb_stimulatorSelector(source,~)
                if(isvalid(obj.pi.mm.stimulatorSelector))
                    
                    obj.pi.mm.stimulatorSelector.Color='k';
                end
                obj.pi.mm.stim.(cd).slctd=str2double(source.Tag);
                source.Color='b';
                obj.pi.mm.stimulatorSelector=source;
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
% line 1517 links to 0 best_requirements.slreqx#29: interacting with axes to add pulses on any stimulator
            obj.pi.mm.stim.(cd).(st).plt=plot(x,y,'Color','k','parent',obj.pi.mm.cond.(cd).ax,'LineWidth',2,'Tag',num2str(obj.pi.mm.stim.(cd).slctd),'ButtonDownFcn',@cb_stimulatorSelector); %line

% lines 1531-1539 links to 0 best_requirements.slreqx#29: interacting with axes to add pulses on any stimulator
            function cb_stimulatorSelector(source,~)
                if(isvalid(obj.pi.mm.stimulatorSelector))
                    
                    obj.pi.mm.stimulatorSelector.Color='k';
                end
                obj.pi.mm.stim.(cd).slctd=str2double(source.Tag);
                source.Color='b';
                obj.pi.mm.stimulatorSelector=source;
            end

% lines 1634-1641 links to 0 best_requirements.slreqx#63: duplicae to make a new identical condition with new cond No
            uicontrol( 'Style','text','Parent', r2b,'String','Inter Stimulus Interval (ms):','FontSize',11,'HorizontalAlignment','left','Units','normalized');
            isi=uicontrol( 'Style','edit','Parent', r2b ,'FontSize',11);
            set( r2b, 'Widths', [250 200]);

            r2=uix.HBox('parent',c1);
            uicontrol( 'Style','text','Parent', r2,'String','Intensity Units:','FontSize',11,'HorizontalAlignment','left','Units','normalized');
            units_mso=uicontrol( 'Style','radiobutton','Parent', r2 ,'FontSize',11,'String','%MSO','Value',1,'Callback',@(~,~)cb_units_mso);
            units_mt=uicontrol( 'Style','radiobutton','Parent', r2 ,'FontSize',11,'String','%MT','Callback',@(~,~)cb_units_mt);

% lines 1641-1660 links to 0 best_requirements.slreqx#64: delete a condition and remove it from pars
            units_mt=uicontrol( 'Style','radiobutton','Parent', r2 ,'FontSize',11,'String','%MT','Callback',@(~,~)cb_units_mt);
            set( r2, 'Widths', [250 100 100]);
                   
            r3=uix.HBox('parent',c1);
            uicontrol( 'Style','text','Parent', r3,'String','Motor Threshold (%MSO):','FontSize',11,'HorizontalAlignment','left','Units','normalized');
            threshold=uicontrol( 'Style','edit','Parent', r3 ,'FontSize',11);
            mt_btn_listbox_str_id= find(strcmp(obj.data.(obj.info.event.current_session).info.measurement_str_original,'MEP Motor Threshold Hunting'));
            mt_btn_listbox_str=obj.data.(obj.info.event.current_session).info.measurement_str_to_listbox(mt_btn_listbox_str_id);
            mt_btn_listbox_str=['Select' mt_btn_listbox_str];
            uiextras.HBox('Parent',r3)
            th_dropdown=uicontrol( 'Style','popupmenu','Parent', r3 ,'FontSize',11,'String',mt_btn_listbox_str);     % 11-Mar-2020 14:48:46                                                                  % 1297
            set( r3, 'Widths', [250 80 20 100]);
            

            uicontrol( 'Parent', c1 ,'Style','PushButton','String','OK','FontWeight','Bold','Callback',@(~,~)cb_ok);
            
            set(c1, 'Heights', [25 25 25 25 25 25])
            f.Position(3)=480;
            f.Position(4)=220;
            function cb_ok

% lines 1690-1699 links to 0 best_requirements.slreqx#63: duplicae to make a new identical condition with new cond No
        function cb_pi_mm_train_inputfig(obj,source,~)
            f=figure('ToolBar','none','MenuBar','none','Name','Insert Parameters | BEST Toolbox','NumberTitle','off');
            c1=uix.VBox('parent',f,'Padding',10,'Spacing',10);
            r1=uix.HBox('parent',c1);
            uicontrol( 'Style','text','Parent', r1,'String','Stimulation Intensities (TS):','FontSize',11,'HorizontalAlignment','left','Units','normalized');
            si=uicontrol( 'Style','edit','Parent', r1 ,'FontSize',11);
            set( r1, 'Widths', [250 200]);
            
            r2a=uix.HBox('parent',c1);
            uicontrol( 'Style','text','Parent', r2a,'String','Pulse Frequency (Hz):','FontSize',11,'HorizontalAlignment','left','Units','normalized');

% lines 1699-1716 links to 0 best_requirements.slreqx#64: delete a condition and remove it from pars
            uicontrol( 'Style','text','Parent', r2a,'String','Pulse Frequency (Hz):','FontSize',11,'HorizontalAlignment','left','Units','normalized');
            freq=uicontrol( 'Style','edit','Parent', r2a ,'FontSize',11);
            set( r2a, 'Widths', [250 200]);
            
            r2b=uix.HBox('parent',c1);
            uicontrol( 'Style','text','Parent', r2b,'String','No of Pulses:','FontSize',11,'HorizontalAlignment','left','Units','normalized');
            pulsesNo=uicontrol( 'Style','edit','Parent', r2b ,'FontSize',11);
            set( r2b, 'Widths', [250 200]);

            r2=uix.HBox('parent',c1);
            uicontrol( 'Style','text','Parent', r2,'String','Intensity Units:','FontSize',11,'HorizontalAlignment','left','Units','normalized');
            units_mso=uicontrol( 'Style','radiobutton','Parent', r2 ,'FontSize',11,'String','%MSO','Value',1,'Callback',@(~,~)cb_units_mso);
            units_mt=uicontrol( 'Style','radiobutton','Parent', r2 ,'FontSize',11,'String','%MT','Callback',@(~,~)cb_units_mt);
            set( r2, 'Widths', [250 100 100]);
                   
            r3=uix.HBox('parent',c1);
            uicontrol( 'Style','text','Parent', r3,'String','Motor Threshold (%MSO):','FontSize',11,'HorizontalAlignment','left','Units','normalized');
            threshold=uicontrol( 'Style','edit','Parent', r3 ,'FontSize',11);